# Grasshopper definition BuddyRingsDuo.gh (Grasshopper 1.0.8)
# plug-ins: Pufferfish

geo_algorithm_name = Panel("BuddyRingsDuo")
is_production_mode = BooleanToggle(False)
toggle_job_make_it_go = BooleanToggle(False)
axial_band_thickness_mm = Panel("1.50")
minimum_band_width_mm = Panel("7.5")
factoryautomatorpy = Python3Script(is_production_mode=is_production_mode, geo_algorithm_name=geo_algorithm_name, toggleJob=toggle_job_make_it_go)  # -> out, c_left_mm, c_right_mm, full_perimeter_mm, right_forward_offset_mm, b_left_slit, b_right_slit, root_filename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; inputs is_production_mode: Boolean, toggleJob: Boolean
# ---------- factoryautomatorpy: Python ----------
from pathlib import Path
import sys
from importlib import reload #FOR DEV
import time

ghFileDir = str(Path.joinpath(Path(ghenv.Component.OnPingDocument().FilePath).resolve().parents[0], "src"))
print(f"{ghFileDir=}")

if ghFileDir not in sys.path:
    print("ghFileDir needed to be included")
    sys.path.append(ghFileDir)

import splintcommon
reload(splintcommon) #FOR DEV
from splintcommon import mark_generation_start
mark_generation_start()
splintcommon.log(f'FactoryAutomatorPY Running at: ({time.strftime("%H:%M:%S", time.localtime())})')
# ==================== Component Code ===========================

def float_range(start, stop, count):
    current = start
    step = (stop - start) / (count - 1)
    result_range = []
    for c in range(count):
        result_range.append(start + (step * c))
    return result_range

job_data, objectID, root_filename, output_dir, raw_data = splintcommon.load_job_data(is_production_mode, geo_algorithm_name)

# This mapping must match the schema of the data in the DB for this geometry type
c_left_mm = job_data["c_left_mm"]
c_right_mm = job_data["c_right_mm"]
full_perimeter_mm = job_data["full_perimeter_mm"]
right_forward_offset_mm = job_data["right_forward_offset_mm"]
b_left_slit = job_data.get("b_left_slit", False)
b_right_slit = job_data.get("b_right_slit", False)

splintcommon.log(f"Result data {c_left_mm=} {c_right_mm=} {full_perimeter_mm=} {right_forward_offset_mm=} {b_left_slit=} {b_right_slit=}")
# ---------- end factoryautomatorpy ----------
# BuddyRings
panel = Panel(factoryautomatorpy.out)
output_dir_out = Text(factoryautomatorpy.output_dir)
root_filename_out = Text(factoryautomatorpy.root_filename)
axial_band_thickness_mm_2 = Number(axial_band_thickness_mm)
b_left_slit = Boolean(factoryautomatorpy.b_left_slit)
b_right_slit = Boolean(factoryautomatorpy.b_right_slit)
c_left_mm = Panel(factoryautomatorpy.c_left_mm)
right_forward_offset_mm = Panel(factoryautomatorpy.right_forward_offset_mm)
full_perimeter_mm = Panel(factoryautomatorpy.full_perimeter_mm)
c_right_mm = Panel(factoryautomatorpy.c_right_mm)
objectid = Panel(factoryautomatorpy.objectID)
unit_x = UnitX(Factor=1)
unit_y = UnitY(Factor=1)

# ----
# Finger Circles
c_left = Number(c_left_mm)
full_perimeter = Number(full_perimeter_mm)
c_right = Number(c_right_mm)
axial_band_thickness_mm_3 = Number(axial_band_thickness_mm)
two_sphere_dist_solver_py = Python3Script(c1=c_left, c2=c_right, full_perimeter=full_perimeter)  # -> out, r1, r2, gap, center_to_center; inputs c1: Double, c2: Double, full_perimeter: Double
# ---------- two_sphere_dist_solver_py: Python ----------
import math

# Inputs (from GH component)
circumference_1 = c1  # larger circle circumference
circumference_2 = c2  # smaller circle circumference
belt_perimeter = full_perimeter    # convex hull perimeter measurement
is_radius_reversed = False

# Derive radii
r1 = circumference_1 / (2 * math.pi)
r2 = circumference_2 / (2 * math.pi)

# Ensure r1 >= r2
if r2 > r1:
    is_radius_reversed = True
    r1, r2 = r2, r1

def hull_perimeter(d, r1, r2):
    """Convex hull perimeter of two disks with center distance d."""
    tangent_len = 2 * math.sqrt(d**2 - (r1 - r2)**2)
    arc_base = math.pi * (r1 + r2)
    arc_correction = 2 * (r1 - r2) * math.asin((r1 - r2) / d)
    return tangent_len + arc_base + arc_correction

# Bisection solve for center-to-center distance
d_lo = r1 + r2 + 1e-9  # circles just touching
d_hi = belt_perimeter / 2.0
tolerance = 1e-9

for _ in range(200):
    d_mid = (d_lo + d_hi) / 2.0
    if hull_perimeter(d_mid, r1, r2) < belt_perimeter:
        d_lo = d_mid
    else:
        d_hi = d_mid
    if (d_hi - d_lo) < tolerance:
        break

center_distance = (d_lo + d_hi) / 2.0
gap = center_distance - r1 - r2

#Now unreverse the radius if necessary
if is_radius_reversed:
    r1, r2 = r2, r1

center_to_center = r1 + r2 + gap
# ---------- end two_sphere_dist_solver_py ----------
yz_plane = YZPlane(Origin=Point(0, 0, 0))
unit_y_2 = UnitY(Factor=expr("-x", two_sphere_dist_solver_py.center_to_center))
circle_left = Circle(Plane=yz_plane, Radius=two_sphere_dist_solver_py.r1)
circle_right = Circle(Plane=yz_plane, Radius=two_sphere_dist_solver_py.r2)
move = Move(Geometry=circle_right, Motion=unit_y_2)  # -> Geometry, Transform
circle_right_2 = Circle(move.Geometry)
circle_left_2 = Circle(circle_left)
r_right = Number(two_sphere_dist_solver_py.r2)
r_left = Number(two_sphere_dist_solver_py.r1)

addition = Addition(A=two_sphere_dist_solver_py.r1, B=axial_band_thickness_mm_3)
addition_2 = Addition(A=two_sphere_dist_solver_py.r2, B=axial_band_thickness_mm_3)

circle_left_3 = Circle(Plane=yz_plane, Radius=addition)
circle_right_3 = Circle(Plane=yz_plane, Radius=addition_2)
transform = Transform(Geometry=circle_right_3, Transform=move.Transform)
outer_circle_left = Circle(circle_left_3)
outer_circle_right = Circle(transform)
r_right_outer = Number(addition_2)
r_left_outer = Number(addition)

# ----
# Create Outer Shell Wall
outer_circle_left_2 = Circle(outer_circle_left)
r_right_outer_2 = Number(r_right_outer)
r_left_outer_2 = Number(r_left_outer)
outer_circle_right_2 = Circle(outer_circle_right)
smaller_than = SmallerThan(FirstNumber=r_left_outer_2, SecondNumber=r_right_outer_2)  # -> SmallerThan, OrEqualTo
pick_n_choose = PickNChoose(Pattern=smaller_than.OrEqualTo, Stream0=r_right_outer_2, Stream1=r_left_outer_2)
division = Division(A=pick_n_choose, B="2")
python_3_script = Python3Script(circle1=outer_circle_left_2, circle2=outer_circle_right_2, hourglass_r=division)  # -> out, a; inputs circle1: Circle, circle2: Circle, hourglass_r: Double
# ---------- python_3_script: Python ----------
import Rhino.Geometry as rg
import math


def create_hourglass(circle1, circle2, hourglass_r, tolerance=0.01):
    """Create an hourglass-shaped closed curve joining two non-overlapping circles."""
    c1 = circle1.Center
    c2 = circle2.Center
    r1 = circle1.Radius
    r2 = circle2.Radius

    # Direction from c1 to c2
    axis = c2 - c1
    dist = axis.Length
    axis.Unitize()

    # Perpendicular direction in the circle plane
    normal = circle1.Plane.ZAxis
    perp = rg.Vector3d.CrossProduct(normal, axis)
    perp.Unitize()

    print("C1: r={:.3f}, C2: r={:.3f}, dist={:.3f}, hourglass_r={:.3f}".format(
        r1, r2, dist, hourglass_r))

    # Construction radii (externally tangent)
    R1 = r1 + hourglass_r
    R2 = r2 + hourglass_r

    # Circle-circle intersection: find tangent circle centers
    # x = offset along axis from c1, y = perpendicular offset
    x = (dist * dist + R1 * R1 - R2 * R2) / (2.0 * dist)
    y_sq = R1 * R1 - x * x

    if y_sq < 0:
        print("ERROR: no tangent circles exist (y^2={:.3f}). Adjust hourglass_r.".format(y_sq))
        return None

    y = math.sqrt(y_sq)
    base = c1 + axis * x
    t1_center = base + perp * y
    t2_center = base - perp * y

    print("T1 center: {}, T2 center: {}".format(t1_center, t2_center))

    # 4 tangent points (on original circles, toward tangent circle centers)
    def tangent_pt(circ_center, circ_r, tang_center):
        v = tang_center - circ_center
        v.Unitize()
        return circ_center + v * circ_r

    p_c1_t1 = tangent_pt(c1, r1, t1_center)
    p_c1_t2 = tangent_pt(c1, r1, t2_center)
    p_c2_t1 = tangent_pt(c2, r2, t1_center)
    p_c2_t2 = tangent_pt(c2, r2, t2_center)

    # Interior points for 3-point arc construction
    c1_far = c1 - axis * r1                    # C1 farthest from C2
    c2_far = c2 + axis * r2                    # C2 farthest from C1
    t1_inner = t1_center - perp * hourglass_r  # T1 closest to centerline
    t2_inner = t2_center + perp * hourglass_r  # T2 closest to centerline

    # 4 arcs in continuous path order
    arc_c1 = rg.Arc(p_c1_t2, c1_far, p_c1_t1)   # C1 outer (away from C2)
    arc_t1 = rg.Arc(p_c1_t1, t1_inner, p_c2_t1)  # T1 waist (concave inward)
    arc_c2 = rg.Arc(p_c2_t1, c2_far, p_c2_t2)    # C2 outer (away from C1)
    arc_t2 = rg.Arc(p_c2_t2, t2_inner, p_c1_t2)  # T2 waist (concave inward)

    curves = [
        rg.ArcCurve(arc_c1),
        rg.ArcCurve(arc_t1),
        rg.ArcCurve(arc_c2),
        rg.ArcCurve(arc_t2),
    ]

    print("Arc lengths: C1={:.3f}, T1={:.3f}, C2={:.3f}, T2={:.3f}".format(
        curves[0].GetLength(), curves[1].GetLength(),
        curves[2].GetLength(), curves[3].GetLength()))

    joined = rg.Curve.JoinCurves(curves, tolerance)
    if joined and len(joined) > 0:
        result = joined[0]
        print("Joined: closed={}, length={:.3f}".format(result.IsClosed, result.GetLength()))
        return result
    else:
        print("WARNING: JoinCurves failed, returning individual arcs")
        return curves


# GH component inputs: circle1, circle2, hourglass_r, tolerance
a = create_hourglass(circle1, circle2, hourglass_r, 0.1)
# ---------- end python_3_script ----------
outer_perimeter_curve = Curve(python_3_script.a)

# ----
# Solid Blank
right_forward_offset_mm_2 = Number(right_forward_offset_mm)
outer_perimeter_curve_2 = Curve(outer_perimeter_curve)
initial_circle_right = Circle(circle_right_2)
initial_circle_left = Circle(circle_left_2)
smaller_than_2 = SmallerThan(FirstNumber=right_forward_offset_mm_2, SecondNumber="0")  # -> SmallerThan, OrEqualTo
merge = Merge(Data1=outer_perimeter_curve_2, Data2=initial_circle_left, Data3=initial_circle_right)  # -> flatten(Result)
unit_x_2 = UnitX(Factor=right_forward_offset_mm_2)
pick_n_choose_2 = PickNChoose(Pattern=smaller_than_2.SmallerThan, Stream0="0", Stream1=right_forward_offset_mm_2)
boundary_surfaces = BoundarySurfaces(Edges=merge)
move_2 = Move(Geometry=initial_circle_right, Motion=unit_x_2)  # -> Geometry, Transform
unit_x_3 = UnitX(Factor="100")
unit_x_4 = UnitX(Factor=pick_n_choose_2)
extrude = Extrude(Base=boundary_surfaces, Direction=unit_x_3)
move_3 = Move(Geometry=outer_perimeter_curve_2, Motion=unit_x_4)  # -> Geometry, Transform
move_4 = Move(Geometry=extrude, Motion=unit_x_4)  # -> Geometry, Transform
outer_perimeter_positioned_left = Curve(outer_perimeter_curve_2)
outer_perimeter_positioned_right = Curve(move_3.Geometry)
circle_left_positioned = Circle(initial_circle_left)
circle_right_positioned = Circle(move_2.Geometry)
blank_positioned = Brep(move_4.Geometry)

r_left_2 = Number(r_left)

# ----
# Solid Intersection Template
minimum_band_width_mm_2 = Number(minimum_band_width_mm)
blank_positioned_2 = Brep(blank_positioned)
unit_x_5 = UnitX(Factor=minimum_band_width_mm_2)
move_5 = Move(Geometry=circle_left_positioned, Motion=unit_x_5)  # -> Geometry, Transform
transform_2 = Transform(Geometry=outer_perimeter_positioned_right, Transform=move_5.Transform)
transform_3 = Transform(Geometry=circle_right_positioned, Transform=move_5.Transform)
transform_4 = Transform(Geometry=outer_perimeter_positioned_left, Transform=move_5.Transform)
far_left_forward = Panel("1000, 1000, 0")
far_left_back = Panel("-1000, 1000, 0")
far_right_forward = Panel("1000, -1000, 0")
far_right_backward = Panel("-1000, -1000, 0")
point = Point(far_left_forward)
point_2 = Point(far_left_back)
point_3 = Point(far_right_forward)
point_4 = Point(far_right_backward)
curve_closest_point = CurveClosestPoint(Point=point, Curve=transform_4)  # -> Point, Parameter, Distance
curve_closest_point_2 = CurveClosestPoint(Point=point_3, Curve=transform_2)  # -> Point, Parameter, Distance
curve_closest_point_3 = CurveClosestPoint(Point=point_2, Curve=outer_perimeter_positioned_left)  # -> Point, Parameter, Distance
curve_closest_point_4 = CurveClosestPoint(Point=point_4, Curve=outer_perimeter_positioned_right)  # -> Point, Parameter, Distance
merge_2 = Merge(
    Data1=curve_closest_point.Point,
    Data2=curve_closest_point_2.Point,
    Data3=curve_closest_point_4.Point,
    Data4=curve_closest_point_3.Point)  # -> flatten(Result)
polyline = PolyLine(Vertices=merge_2, Closed=True)
unit_z = UnitZ(Factor="-100")
move_6 = Move(Geometry=polyline, Motion=unit_z)  # -> Geometry, Transform
reverse = Reverse(Vector=unit_z)
boundary_surfaces_2 = BoundarySurfaces(Edges=move_6.Geometry)
multiplication = Multiplication(A=reverse, B="2")
blank_positioned_3 = Brep(blank_positioned_2)
extrude_2 = Extrude(Base=boundary_surfaces_2, Direction=multiplication)
solid_intersection = SolidIntersection(BrepsA=extrude_2, BrepsB=blank_positioned_3)
python_3_script_2 = Python3Script(fillet_brep=solid_intersection, fillet_r="0.5")  # -> out, output_brep; inputs fillet_brep: Brep, fillet_r: Double
# ---------- python_3_script_2: Python ----------
import Rhino.Geometry as rg
import math


def find_sharp_edges(brep, min_angle_degrees=10.0):
    """Find brep edges where adjacent faces meet at greater than min_angle_degrees."""
    sharp_edges = []
    threshold_rad = math.radians(min_angle_degrees)
    
    print("Scanning {} edges for angles > {} deg".format(brep.Edges.Count, min_angle_degrees))
    
    for edge in brep.Edges:
        face_indices = edge.AdjacentFaces()
        if len(face_indices) != 2:
            print("  Edge {} skipped: {} adjacent faces (naked/non-manifold)".format(edge.EdgeIndex, len(face_indices)))
            continue
        
        face_a = brep.Faces[face_indices[0]]
        face_b = brep.Faces[face_indices[1]]
        
        mid_t = edge.Domain.Mid
        mid_pt = edge.PointAt(mid_t)
        
        ok_a, u_a, v_a = face_a.ClosestPoint(mid_pt)
        ok_b, u_b, v_b = face_b.ClosestPoint(mid_pt)
        if not (ok_a and ok_b):
            print("  Edge {} skipped: ClosestPoint failed on face {} or {}".format(
                edge.EdgeIndex, face_indices[0], face_indices[1]))
            continue
        
        normal_a = face_a.NormalAt(u_a, v_a)
        normal_b = face_b.NormalAt(u_b, v_b)
        
        angle = rg.Vector3d.VectorAngle(normal_a, normal_b)
        angle_deg = math.degrees(angle)
        
        if angle > threshold_rad:
            print("  Edge {} SHARP: {:.1f} deg (faces {} & {}, len={:.2f})".format(
                edge.EdgeIndex, angle_deg, face_indices[0], face_indices[1], edge.GetLength()))
            sharp_edges.append((edge, angle_deg))
    
    print("Found {} sharp edges out of {} total".format(len(sharp_edges), brep.Edges.Count))
    return sharp_edges


def check_brep_health(brep):
    """Log brep validity status."""
    is_valid = brep.IsValid
    is_solid = brep.IsSolid
    naked = 0
    for edge in brep.Edges:
        if len(edge.AdjacentFaces()) < 2:
            naked += 1
    print("  Brep health: valid={}, solid={}, naked_edges={}".format(is_valid, is_solid, naked))
    return naked == 0


def fillet_sharp_edges(brep, radius, min_angle_degrees=10.0, tolerance=0.01, max_passes=30):
    """Fillet sharp edges, batch-first with one-at-a-time fallback."""
    print("=== fillet_sharp_edges: radius={}, min_angle={} deg, tol={} ===".format(
        radius, min_angle_degrees, tolerance))
    check_brep_health(brep)
    
    # Capture original sharp edge midpoints as our target set
    original_sharp = find_sharp_edges(brep, min_angle_degrees)
    if not original_sharp:
        print("No sharp edges found, returning original brep")
        return [brep]
    
    target_points = []
    for edge, angle in original_sharp:
        mid_t = edge.Domain.Mid
        target_points.append(edge.PointAt(mid_t))
    
    print("Recorded {} original sharp edge midpoints".format(len(target_points)))
    
    current = brep
    blend_type = rg.BlendType.Fillet
    rail_type = rg.RailType.DistanceFromEdge
    match_tol = tolerance * 10
    
    for pass_num in range(max_passes):
        check_brep_health(current)
        
        # Find sharp edges on current brep that match an original midpoint
        sharp_with_angles = find_sharp_edges(current, min_angle_degrees)
        candidates = []
        for edge, angle in sharp_with_angles:
            mid_t = edge.Domain.Mid
            mid_pt = edge.PointAt(mid_t)
            for tp in target_points:
                if mid_pt.DistanceTo(tp) < match_tol:
                    candidates.append((edge, angle))
                    break
        
        if not candidates:
            print("Pass {}: no original sharp edges remain, done".format(pass_num))
            break
        
        # Sort candidates: hardest angles first (farthest from 90)
        candidates.sort(key=lambda x: abs(x[1] - 90.0), reverse=True)
        
        print("Pass {}: {} original sharp edges, sorted by difficulty:".format(pass_num, len(candidates)))
        for edge, angle in candidates:
            print("  edge {} @ {:.1f} deg".format(edge.EdgeIndex, angle))
        
        # Strategy 1: try ALL remaining original edges as a batch
        batch_indices = [e.EdgeIndex for e, a in candidates]
        batch_radii = [radius] * len(batch_indices)
        print("  Trying batch fillet: {}".format(batch_indices))
        result = rg.Brep.CreateFilletEdges(
            current,
            batch_indices,
            batch_radii,
            batch_radii,
            blend_type,
            rail_type,
            tolerance
        )
        if result and len(result) > 0:
            print("  BATCH SUCCESS: {} brep(s) returned".format(len(result)))
            current = result[0]
            continue
        else:
            print("  Batch failed")
        
        # Strategy 2: one-at-a-time, hardest first
        filleted = False
        for edge, angle in candidates:
            idx = edge.EdgeIndex
            print("  trying edge {} ({:.1f} deg)".format(idx, angle))
            result = rg.Brep.CreateFilletEdges(
                current,
                [idx],
                [radius],
                [radius],
                blend_type,
                rail_type,
                tolerance
            )
            if result and len(result) > 0:
                print("  success on edge {}".format(idx))
                current = result[0]
                filleted = True
                break
            else:
                print("  FAILED on edge {}".format(idx))
        
        if not filleted:
            print("No edges could be filleted at radius {}, stopping".format(radius))
            break
    
    return [current]


# -- GH component usage --
output_brep = fillet_sharp_edges(fillet_brep, fillet_r, 20.0, 0.1)
# ---------- end python_3_script_2 ----------
unit_x_6 = UnitX(Factor="20")
panel_2 = Panel(python_3_script_2.out)
brep = Brep(python_3_script_2.output_brep)
move_7 = Move(Geometry=brep, Motion=unit_x_6)  # -> Geometry, Transform
splint_brep = Brep(brep)

print_bed_laydown_line = Line(StartPoint=curve_closest_point_3.Point, EndPoint=curve_closest_point_4.Point)

# ----
# Left Slit
b_left_slit_2 = Boolean(b_left_slit)
splint_brep_2 = Brep(splint_brep)
shortcircuit_slit_py = Python3Script(is_slit_active=b_left_slit_2, splint_brep=splint_brep_2)  # -> out, brep_to_slit, brep_to_shortcircuit; inputs is_slit_active: Boolean, splint_brep: Brep
# ---------- shortcircuit_slit_py: Python ----------
if is_slit_active:
    brep_to_slit = splint_brep
    brep_to_shortcircuit = None
else:
    brep_to_slit = None
    brep_to_shortcircuit = splint_brep
# ---------- end shortcircuit_slit_py ----------
unit_z_2 = UnitZ(Factor=1)  # disabled
unit_x_7 = UnitX(Factor=1)  # disabled
box_center_slice_py = Python3Script(target_brep=splint_brep_2, view_vector=unit_z_2)  # -> out, slice_surface, y_shift; inputs target_brep: Brep, view_vector: Vector3d; disabled; same code as box_center_slice_py
box_center_slice_py_2 = Python3Script(target_brep=shortcircuit_slit_py.brep_to_slit, view_vector=unit_x_7)  # -> out, slice_surface, y_shift; inputs target_brep: Brep, view_vector: Vector3d; disabled; same code as box_center_slice_py
unit_y_3 = UnitY(Factor=box_center_slice_py_2.y_shift)  # disabled
move_8 = Move(Geometry=box_center_slice_py.slice_surface, Motion=unit_y_3)  # -> Geometry, Transform; disabled
python_3_script_3 = Python3Script(splint_brep=splint_brep_2, slit_panel=move_8.Geometry)  # -> out, brep_out; inputs splint_brep: Brep, slit_panel: Brep; disabled
# ---------- python_3_script_3: Python ----------
# This file represents a stub for a GhPython component in Grasshopper.
# It sets up the environment to import and use the splintcommon or other external modules.

from pathlib import Path
import sys
from importlib import reload #FOR DEV
import time

# Walk up through nested clusters to find the root GH document (necessary for use in nested clusters)
doc = ghenv.Component.OnPingDocument()
while not doc.FilePath and doc.Owner:
    doc = doc.Owner.OnPingDocument()
ghFileDir = str(Path(doc.FilePath).resolve().parent / "src")

print(f"{ghFileDir=}")

if ghFileDir not in sys.path:
    print("ghFileDir needed to be included")
    sys.path.append(ghFileDir)

import splintcommon
reload(splintcommon) #FOR DEV
from splintcommon import mark_generation_start
mark_generation_start()

#splintcommon module is now available for use in this GhPython component
splintcommon.log(f'GhPython Node initialized at {time.ctime()}')

#Component code here

import BrepSlit
reload(BrepSlit)
from BrepSlit import cut_slit

slit_thickness = 0.1
fillet_radius = 0.3

brep_out = cut_slit(splint_brep, slit_panel, slit_thickness, fillet_radius)
# ---------- end python_3_script_3 ----------
shortcircuit_slit_py_2 = Python3Script(slit_brep=python_3_script_3.brep_out, splint_brep=shortcircuit_slit_py.brep_to_shortcircuit)  # -> out, out_brep; inputs is_slit_active: Boolean, slit_brep: Brep, splint_brep: Brep; disabled
# ---------- shortcircuit_slit_py_2: Python ----------
print(f"{is_slit_active=}")
if is_slit_active:
    print("Returning the slit brep")
    out_brep = slit_brep
else:
    print("Returning the boring splint")
    out_brep = splint_brep
# ---------- end shortcircuit_slit_py_2 ----------
splint_brep_3 = Brep(shortcircuit_slit_py_2.out_brep)  # disabled

# ----
# Right Slit
b_right_slit_2 = Boolean(b_right_slit)  # disabled
splint_brep_4 = Brep(splint_brep_3)  # disabled
shortcircuit_slit_py_3 = Python3Script(is_slit_active=b_right_slit_2, splint_brep=splint_brep_4)  # -> out, brep_to_slit, brep_to_shortcircuit; inputs is_slit_active: Boolean, splint_brep: Brep; disabled; same code as shortcircuit_slit_py
unit_z_3 = UnitZ(Factor=1)  # disabled
unit_x_8 = UnitX(Factor=1)  # disabled
box_center_slice_py_3 = Python3Script(target_brep=splint_brep_4, view_vector=unit_z_3)  # -> out, slice_surface, y_shift; inputs target_brep: Brep, view_vector: Vector3d; disabled; same code as box_center_slice_py
box_center_slice_py_4 = Python3Script(target_brep=shortcircuit_slit_py_3.brep_to_slit, view_vector=unit_x_8)  # -> out, slice_surface, y_shift; inputs target_brep: Brep, view_vector: Vector3d; disabled; same code as box_center_slice_py
unit_y_4 = UnitY(Factor=box_center_slice_py_4.y_shift)  # disabled
move_9 = Move(Geometry=box_center_slice_py_3.slice_surface, Motion=unit_y_4)  # -> Geometry, Transform; disabled
python_3_script_4 = Python3Script(splint_brep=splint_brep_4, slit_panel=move_9.Geometry)  # -> out, brep_out; inputs splint_brep: Brep, slit_panel: Brep; disabled; same code as python_3_script_3
shortcircuit_slit_py_4 = Python3Script(slit_brep=python_3_script_4.brep_out, splint_brep=shortcircuit_slit_py_3.brep_to_shortcircuit)  # -> out, out_brep; inputs is_slit_active: Boolean, slit_brep: Brep, splint_brep: Brep; disabled
# ---------- shortcircuit_slit_py_4: Python ----------
if is_slit_active:
    out_brep = slit_brep
else:
    out_brep = splint_brep
# ---------- end shortcircuit_slit_py_4 ----------
splint_brep_5 = Brep(shortcircuit_slit_py_4.out_brep)  # disabled

print_bed_laydown_line_2 = Line(print_bed_laydown_line)

print_bed_laydown_line_3 = Line(print_bed_laydown_line_2)
unit_vector = UnitVector(Vector=print_bed_laydown_line_3)
end_points = EndPoints(Curve=print_bed_laydown_line_3)  # -> Start, End
point_5 = Point(end_points.Start)
point_6 = Point(end_points.End)

# ----
# ID Embossing Gun
text_size = Slider(3.3, range=2.5..6)
axial_band_thickness_mm_4 = Number(axial_band_thickness_mm_2)
objectid_2 = Text(objectid)
side_projection_angle = Panel("32")
finishedsplintbrep = Brep(splint_brep_5)
panel_3 = Panel(objectid_2)
vizvector = Arrow(direction=Vector(0, 0, 1), arrowlen="4", text="up")  # -> cone_2, line, annotation_dot_2
vizvector_2 = Arrow(direction=Vector(0, 0, 1), arrowlen="4", text="proj")  # -> cone_2, line, annotation_dot_2
tip = Brep(vizvector.cone_2)
line = Line(vizvector.line)
annotation_dot = AnnotationDot(vizvector.annotation_dot_2)

find_text_origin_cl = FindTextOriginCL(target_brep_2=finishedsplintbrep, target_brep=finishedsplintbrep, r_left=r_left_2)
text_origin_pt = Point(find_text_origin_cl)

textgun_py = Python3Script(
    splint_brep=finishedsplintbrep,
    object_id=objectid_2,
    text_up_vector=unit_x,
    wall_thickness_mm=axial_band_thickness_mm_4,
    text_size=text_size,
    text_projection_vector=unit_y,
    extrusion_depth_factor="0.25",
    projection_origin=text_origin_pt,
    x=Toggle(False))  # -> out, embossedBrep, originalTextBreps, final_text_plane, projected_letters; inputs splint_brep: Brep, object_id: String, text_up_vector: Vector3d, text_size: Double, text_projection_vector: Vector3d, extrusion_depth_factor: Double, projection_origin: Point3d
# ---------- textgun_py: Python ----------
# This file represents a stub for a GhPython component in Grasshopper.
# It sets up the environment to import and use the splintcommon or other external modules.

from pathlib import Path
import sys
from importlib import reload #FOR DEV ONLY
import time

# In normal GH doc
ghFileDir = None
try:
    ghFileDir = str(Path.joinpath(Path(ghenv.Component.OnPingDocument().FilePath).resolve().parents[0], "src"))
except:
    # In GH Cluster
    ghFileDir = str(Path.joinpath(Path(ghenv.Component.OnPingDocument().Owner.OnPingDocument().FilePath).resolve().parents[0], "src"))

print(f"{ghFileDir=}")

if ghFileDir not in sys.path:
    print("ghFileDir needed to be included")
    sys.path.append(ghFileDir)

import splintcommon
reload(splintcommon) #FOR DEV

#splintcommon module is now available for use in this GhPython component
splintcommon.log(f'GhPython Node initialized at {time.ctime()}')

import TextGun
reload(TextGun) #FOR DEV
from TextGun import emboss_text

embossedBrep, originalTextBreps, projected_letters, final_text_plane = emboss_text(
    target_brep=splint_brep,
    text_content=object_id,
    wall_thickness_mm=wall_thickness_mm,
    text_size=text_size,
    text_up_vector=text_up_vector,
    text_projection_vector=text_projection_vector,
    extrusion_depth_factor=extrusion_depth_factor,
    projection_origin=projection_origin,
    emboss_inside=True,
    align_to_surface_normal=True
)
# ---------- end textgun_py ----------
plane = Plane(textgun_py.final_text_plane)
vizplane = VizPlane(plane=plane)  # -> tip_2, line_2, annotation_dot_2
tip_2 = Brep(vizplane.tip_2)
line_2 = Line(vizplane.line_2)
annotation_dot_2 = AnnotationDot(vizplane.annotation_dot_2)
panel_4 = Panel(textgun_py.out)
brep_2 = Brep(textgun_py.originalTextBreps)
plane_2 = Plane(textgun_py.final_text_plane)
splint_with_embossed_id = Brep(textgun_py.embossedBrep)
brep_3 = Brep(graft(textgun_py.projected_letters))
panel_5 = Panel(brep_3)
splint_with_embossed_id_2 = Brep(textgun_py.embossedBrep)
splint_with_embossed_id_3 = Brep(textgun_py.embossedBrep)

# ----
# Direction Indicator
splint_body = Brep(splint_with_embossed_id_3)
ball_r_to_wall_ratio = Slider(0.68, range=0.6..1)
axial_band_thickness_mm_5 = Number(axial_band_thickness_mm_2)
unit_y_5 = UnitY(Factor=1)
box_center_slice_py_5 = Python3Script(target_brep=splint_body, view_vector=unit_y_5)  # -> out, slice_surface, y_shift; inputs target_brep: Brep, view_vector: Vector3d; same code as box_center_slice_py
multiplication_2 = Multiplication(A=axial_band_thickness_mm_5, B=ball_r_to_wall_ratio)
nub_radius = Panel(multiplication_2)
xy_plane = XYPlane(Origin=Point(0, 0, 0))
brep_brep = BrepBrep(BrepA=splint_body, BrepB=box_center_slice_py_5.slice_surface)  # -> Curves, Points
sphere = Sphere(Base=xy_plane, Radius=nub_radius)
area = Area(Geometry=brep_brep.Curves)  # -> Area, Centroid
unit_z_4 = UnitZ(Factor="500")
move_10 = Move(Geometry=area.Centroid, Motion=unit_z_4)  # -> Geometry, Transform
curve_closest_point_5 = CurveClosestPoint(Point=move_10.Geometry, Curve=brep_brep.Curves)  # -> Point, Parameter, Distance
deconstruct = Deconstruct(Point=curve_closest_point_5.Point)  # -> XComponent, YComponent, ZComponent
construct_point = ConstructPoint(XCoordinate="100", YCoordinate=deconstruct.YComponent, ZCoordinate="100")
curve_closest_point_6 = CurveClosestPoint(Point=construct_point, Curve=brep_brep.Curves)  # -> Point, Parameter, Distance
line_3 = Line(StartPoint=curve_closest_point_5.Point, EndPoint=curve_closest_point_6.Point)
point_on_curve = PointOnCurve(line_3, parameter=0.564)
point_7 = Point(point_on_curve)
move_to_point = MoveToPoint(Geometry=sphere, PointA=xy_plane, PointB=point_7)  # -> Moved, Vector, Transform
merge_3 = Merge(Data1=splint_body, Data2=move_to_point.Moved)  # -> flatten(Result)
solid_union = SolidUnion(Breps=merge_3)
splints_w_direction_indicator = Brep(solid_union)

panel_6 = Panel(box_center_slice_py_5.slice_surface)

# ----
# Print Bed Orientation
print_bed_laydown_line_4 = Line(print_bed_laydown_line_2)
splint_brep_6 = Brep(splints_w_direction_indicator)
rotate_axis = RotateAxis(Geometry=splint_brep_6, Angle=degrees("90"), Axis=print_bed_laydown_line_4)  # -> Geometry, Transform
orientedsplint = Brep(rotate_axis.Geometry)

# ----
# Final Meshing
# And Smoothing
# Bake Me
number_slider = Slider(0.12, range=0.05..0.2)
orientedsplint_2 = Brep(orientedsplint)
shrinkwrap = ShrinkWrap(
    Geometry=orientedsplint_2,
    EdgeLength=number_slider,
    Offset=0,
    Smoothing=Slider(8, range=0..10),
    Optimization=10,
    FillHoles=True)
splint_smooth_mesh = Mesh(shrinkwrap)

# ----
# Report Results
dev_activate_toggle = BooleanToggle(True)
axial_band_thickness_mm_6 = Number(axial_band_thickness_mm_2)
py_wall_probe_data = Data()
root_filename_out_2 = Text(root_filename_out)
output_dir_out_2 = Text(output_dir_out)
splint_mesh = Mesh(splint_smooth_mesh)
panel_7 = Panel(py_wall_probe_data)
savemeshpy = Python3Script(
    final_splint_mesh=splint_mesh,
    output_dir=output_dir_out_2,
    root_filename=root_filename_out_2,
    bool_activate=dev_activate_toggle,
    axial_band_thickness_mm=axial_band_thickness_mm_6,
    py_wall_probe_data=py_wall_probe_data)  # -> out; inputs final_splint_mesh: Mesh, axial_band_thickness_mm: Double
# ---------- savemeshpy: Python ----------
# This file represents a stub for a GhPython component in Grasshopper.
# It sets up the environment to import and use the splintcommon or other external modules.

from pathlib import Path
import sys
from importlib import reload #FOR DEV
import time

# Walk up through nested clusters to find the root GH document (necessary for use in nested clusters)
doc = ghenv.Component.OnPingDocument()
while not doc.FilePath and doc.Owner:
    doc = doc.Owner.OnPingDocument()
ghFileDir = str(Path(doc.FilePath).resolve().parent / "src")

print(f"{ghFileDir=}")

if ghFileDir not in sys.path:
    print("ghFileDir needed to be included")
    sys.path.append(ghFileDir)

import splintcommon
reload(splintcommon) #FOR DEV
from splintcommon import log, gh_decode

#splintcommon module is now available for use in this GhPython component
splintcommon.log(f'GhPython Node initialized at {time.ctime()}')

#Component code here

import splintmeshes
reload(splintmeshes)
from splintmeshes import save_job_output

wall_probe_data = gh_decode(py_wall_probe_data)

# With error handling
try:
    log(f"Logging to {output_dir=} {root_filename=}")
    #splintmeshes.save_mesh(final_splint_mesh, output_dir, root_filename, format_type="stl")

    save_job_output(final_splint_mesh, output_dir, root_filename, "stl", custom_metadata={
        "wall_probe_data": wall_probe_data,
        "axial_band_thickness_mm": axial_band_thickness_mm,
    })
    log(f"Export succeeded: {output_dir=} {root_filename=}")
except splintmeshes.MeshExportError as e:
    log("Export failed: {}".format(e))
except ValueError as e:
    log("Bad input: {}".format(e))
# ---------- end savemeshpy ----------
# Bake Me
panel_8 = Panel(savemeshpy)

# ==== cluster VizPlane
plane = ClusterInput()
deconstruct_plane = DeconstructPlane(Plane=plane)  # -> Origin, XAxis, YAxis, ZAxis
arrow = Arrow(start=deconstruct_plane.Origin, direction=deconstruct_plane.XAxis, arrowlen="3", text="X")  # -> cone_2, line, annotation_dot_2
arrow_2 = Arrow(start=deconstruct_plane.Origin, direction=deconstruct_plane.YAxis, arrowlen="3", text="Y")  # -> cone_2, line, annotation_dot_2
arrow_3 = Arrow(start=deconstruct_plane.Origin, direction=deconstruct_plane.ZAxis, arrowlen="3", text="Z")  # -> cone_2, line, annotation_dot_2
tip = Brep([arrow.cone_2, arrow_2.cone_2, arrow_3.cone_2])
line = Line([arrow.line, arrow_2.line, arrow_3.line])
annotation_dot = AnnotationDot([arrow.annotation_dot_2, arrow_2.annotation_dot_2, arrow_3.annotation_dot_2])
tip_2 = ClusterOutput(tip)
line_2 = ClusterOutput(line)
annotation_dot_2 = ClusterOutput(annotation_dot)

# ==== cluster FindTextOriginCL
unit_z = UnitZ(Factor=1)
target_brep = ClusterInput()
box_center_slice_py = Python3Script(target_brep=target_brep, view_vector=unit_z)  # -> out, slice_surface, y_shift; inputs target_brep: Brep, view_vector: Vector3d
# ---------- box_center_slice_py: Python ----------
# This file represents a stub for a GhPython component in Grasshopper.
# It sets up the environment to import and use the splintcommon or other external modules.

from pathlib import Path
import sys
from importlib import reload #FOR DEV
import time

# In normal GH doc
ghFileDir = None
try:
    ghFileDir = str(Path.joinpath(Path(ghenv.Component.OnPingDocument().FilePath).resolve().parents[0], "src"))
except:
    # In GH Cluster
    ghFileDir = str(Path.joinpath(Path(ghenv.Component.OnPingDocument().Owner.OnPingDocument().FilePath).resolve().parents[0], "src"))

print(f"{ghFileDir=}")

if ghFileDir not in sys.path:
    print("ghFileDir needed to be included")
    sys.path.append(ghFileDir)

import splintcommon
reload(splintcommon) #FOR DEV

#splintcommon module is now available for use in this GhPython component
splintcommon.log(f'GhPython Node initialized at {time.ctime()}')

import FeatureIdentification
reload(FeatureIdentification) #FOR DEV
from FeatureIdentification import box_center_slice

import Rhino.Geometry as rg

# Get a slice plane at the center, facing +Y direction
slice_surface, sizes = box_center_slice(
    target_brep=target_brep,
    bbox_plane=rg.Plane.WorldXY,
    choose_side_vector=view_vector,
    return_size=True,
)

print(f"{sizes=}")

y_shift = sizes[1] * .6

print(f"{y_shift=}")
# ---------- end box_center_slice_py ----------
unit_y = UnitY(Factor=box_center_slice_py.y_shift)
target_brep_2 = ClusterInput()
move = Move(Geometry=box_center_slice_py.slice_surface, Motion=unit_y)  # -> Geometry, Transform
target_brep_3 = Brep(target_brep_2)
r_left = ClusterInput()
brep_brep = BrepBrep(BrepA=target_brep_3, BrepB=move.Geometry)  # -> Curves, Points
r_left_2 = Number(r_left)
curve = Curve(brep_brep.Curves)
unit_y_2 = UnitY(Factor=r_left_2)
area = Area(Geometry=brep_brep.Curves)  # -> Area, Centroid
reverse = Reverse(Vector=unit_y_2)
move_2 = Move(Geometry=area.Centroid, Motion=reverse)  # -> Geometry, Transform
geometry = ClusterOutput(move_2.Geometry)

# ==== cluster Arrow
arrowlen = ClusterInput()
text = ClusterInput()
arrowlen_2 = Number(arrowlen)
text_2 = Text(text)
start = ClusterInput()
direction = ClusterInput()
division = Division(A=arrowlen_2, B="4")
line_sdl = LineSDL(Start=start, Direction=direction, Length=arrowlen_2)
end_points = EndPoints(Curve=line_sdl)  # -> Start, End
line = ClusterOutput(line_sdl)
plane_normal = PlaneNormal(Origin=end_points.End, ZAxis=line_sdl)
annotation_dot = AnnotationDot(Location=end_points.End, PrimaryText=text_2)  # -> AnnotationDot, Location, PrimaryText, TextHeight
cone = Cone(Base=plane_normal, Radius=division, Length=division)  # -> Cone, Tip
cone_2 = ClusterOutput(cone.Cone)
annotation_dot_2 = ClusterOutput(annotation_dot.AnnotationDot)
